# Grasshopper definition Chair2.gh (Grasshopper 1.0.7)
# plug-ins: Kangaroo2 Components

geometry = Geometry(<brep referenced from the Rhino model>)
sphere = Sphere(Base=PlaneXY(0, 0, 0), Radius=Slider(20, range=0..100))
geometry_2 = Geometry(<brep referenced from the Rhino model>)
subd = SubD(geometry)
bounding_box = BoundingBox(Content=geometry, Plane=PlaneXY(0, 0, 0))  # -> Box, Box_2
box = Box(geometry)
box_2 = Box(geometry_2)
brep_edges = BrepEdges(Brep=box)  # -> Naked, Interior, NonManifold
brep_edges_2 = BrepEdges(Brep=box_2)  # -> Naked, Interior, NonManifold
area = Area(Geometry=bounding_box.Box)  # -> Area, Centroid
number_slider = Slider(10, range=0..10)
number_slider_2 = Slider(1000, range=0..1000)
list_item = ListItem(List=brep_edges.Interior, Index=Slider(1, range=0..10), Wrap=True)
brep = Brep(subd)
scale = Scale(Geometry=bounding_box.Box, Center=area.Centroid, Factor=Slider(2, range=0..10))  # -> Geometry, Transform
populate_3d = Populate3D(Region=geometry_2, Count=Slider(200, range=0..1000), Seed=1)
list_item_2 = ListItem(List=brep_edges_2.Interior, Index=Slider(1, range=0..10), Wrap=True)
point_on_curve = PointOnCurve(list_item, parameter=0)
vector = Vector(list_item)
voronoi_3d = Voronoi3D(Points=populate_3d)  # -> Cells, Boundary
point_on_curve_2 = PointOnCurve(list_item_2, parameter=0)
populate_3d_2 = Populate3D(Region=scale.Geometry, Count=Slider(1800, range=0..10000), Seed=1)
vector_2 = Vector(list_item_2)
number_slider_3 = Slider(1, range=0..1)
solid_intersection = SolidIntersection(BrepsA=voronoi_3d.Cells, BrepsB=geometry_2)
voronoi_3d_2 = Voronoi3D(Points=populate_3d_2)  # -> Cells, Boundary
contour = Contour(Shape=geometry, Point=point_on_curve, Direction=vector, Distance=Slider(1.2, range=0..10))
solid_intersection_2 = SolidIntersection(BrepsA=brep, BrepsB=graft(voronoi_3d_2.Cells))
multiplication = Multiplication(A=vector, B=Slider(1.2, range=0..10))
brep_edges_3 = BrepEdges(Brep=solid_intersection)  # -> Naked, Interior, NonManifold
contour_2 = Contour(Shape=geometry_2, Point=point_on_curve_2, Direction=vector_2, Distance=Slider(1.5, range=0..10))
multiplication_2 = Multiplication(A=vector_2, B=Slider(1.2, range=0..10))
boundary_surfaces = BoundarySurfaces(Edges=contour)
boundary_surfaces_2 = BoundarySurfaces(Edges=contour_2)
extrude = Extrude(Base=boundary_surfaces, Direction=multiplication)
multipipe = MultiPipe(
    Curves=brep_edges_3.Interior,
    NodeSize=Slider(0, range=0..0.1),
    EndOffset=1,
    StrutSize=Slider(0.01, range=0..0.01),
    Segment=0,
    KinkAngle=0.6,
    CubeFit=0,
    Caps=0)
