# Grasshopper definition Final Project.gh (Grasshopper 1.0.7)
# plug-ins: Biber

# ---- group: Cylinder
unit_z = UnitZ(Factor=Slider(5, range=0..10))
circle = Circle(Plane=PlaneXY(0, 0, 0), Radius=Slider(5, range=0..10))
extrude = Extrude(Base=circle, Direction=unit_z)

# ---- group: Square Box
width = Slider(5, range=0..10)
unit_z_2 = UnitZ(Factor=Slider(5, range=0..10))
rectangle = Rectangle(Plane=PlaneXY(0, 0, 0), XSize=width, YSize=Slider(5, range=0..10), Radius=0)  # -> Rectangle, Length
extrude_2 = Extrude(Base=rectangle.Rectangle, Direction=unit_z_2)
brep = Brep(extrude_2)
cap_holes = CapHoles(Brep=brep)

# ---- group: Using Mesh
sub_list = SubList(Domain=[Domain(5, 5), Domain(0, 0), Domain(1, 1), Domain(3, 3), Domain(2, 2)], Wrap=True)  # -> List, Index
mesh = Mesh(sub_list.List)
merge_faces = MergeFaces(Brep=sub_list.List)  # -> Breps, Before, After
unify_mesh = UnifyMesh(Mesh=mesh)  # -> Result, Count
mesh_to_pps = MeshToPPS(Mesh=unify_mesh.Result)

# ---- group: FindFace
brep_2 = Brep()
deconstruct_brep = DeconstructBrep(Brep=brep_2)  # -> Faces, Edges, Vertices
cull_index = CullIndex(List=deconstruct_brep.Faces, Indices=Slider(0, range=0..100), Wrap=True)
panel = Panel(deconstruct_brep.Faces)
list_item = ListItem(List=deconstruct_brep.Faces, Index=Slider(4, range=0..10), Wrap=True)

# ---- group: Dovetail
dovetail_joint_settings = DovetailJointSettings(
    Angle=10,
    FilletRadius=0,
    Length=1,
    Spacing=1,
    Offset=Slider(0.25, range=0..1),
    Settings_Joint_type=0,
    Settings_Optimzie_fitting=True,
    Settings_Symmetric=0)
dovetail_joint = DovetailJoint(
    Gap=0,
    Extension=0,
    AngleThreshold=degrees(5),
    DovetailJointSetting=dovetail_joint_settings,
    General_Settings=True,
    General_Settings_Config=0,
    General_Settings_Config_Down=0,
    General_Settings_Config_Up=0,
    General_Settings_Config_Value=0,
    General_Settings_Join_Co_planar_sheets=False)

# ----
panel_2 = Panel(cap_holes)
geometry = Geometry(<brep referenced from the Rhino model>)
point = Point(<point referenced from the Rhino model>)
brep_3 = Brep(geometry)
find_seperate_lid = GhPythonScript(brep=cap_holes)  # -> topFace, otherFaces, lid
# ---------- find_seperate_lid: Python ----------
__author__ = "short"
__version__ = "2023.12.05"

import rhinoscriptsyntax as rs
import Rhino.Geometry as rg

#Make sure input is a brep
brep = rs.coercebrep(brep)

#Throw error if input not Brep
if not isinstance(brep, rg.Brep):
    raise ValueError("Input must be a Brep")

#Function to find the top of container
def find_top(brep, tolerance=0.01):
    #Set lid index to none
    top_index = None
    #top_index = 1
    #Our starting max z will be - infinity, so that any number after this will be higher
    max_z = float('-inf')

    #Go through all the faces of the brep using brep.Faces to get them
    for i, face in enumerate(brep.Faces):
        #Find the center point of the face to represent the face.  
        center = face.GetBoundingBox(True).Center; 
        #Check if this face's center point is higher than the current point at max_z
        if center.Z > max_z + tolerance:
            #if it is set the new max_z and index
            max_z = center.Z
            top_index = i

    #finally return the top index
    return top_index 

#save the index of the lid
lid_index = find_top(brep)

#Separate the top face by using the lid index
topFace = brep.Faces[lid_index].DuplicateFace(False)
#Save all other faces for the container
otherFaces = [brep.Faces[i].DuplicateFace(False) for i in range(brep.Faces.Count) if i != lid_index]

lid = topFace
# ---------- end find_seperate_lid ----------

# ---- group: Making The Lid
lid_thickness = Slider(0.3, range=0..1)
negative_shell_default = NegativeShellDefault(Thickness=lid_thickness, FittingDirection=Vector(0, 0, 0))
breps_to_pps = BrepsToPPS(PlanarBreps=find_seperate_lid.lid)
assemble = Assemble(PlanarPolysurface=breps_to_pps, ShellType=negative_shell_default)
disassemble = Disassemble(Assembly=assemble)  # -> Part, Joint, Node
shell_geometry = ShellGeometry(Part=disassemble.Part)  # -> ShellIndex, ConvexEdges, ConvexFaces, Solid, TopPlane, RawPart
lid_before_scale = Brep(shell_geometry.Solid)

# ----
spacing = Slider(0.6, range=0..1)

# ---- group: Shell
thickness = Slider(0.5, range=0..1)
negative_shell_default_2 = NegativeShellDefault(Thickness=thickness, FittingDirection=Vector(0, 0, 0))

# ----
breps_to_pps_2 = BrepsToPPS(PlanarBreps=find_seperate_lid.otherFaces)
blind_finger_joint = BlindFingerJoint(
    Gap=0,
    Extension=0,
    AngleThreshold=degrees(5),
    Spacing=Slider(1, range=0..1),
    Depth=0.25,
    General_Settings=True,
    General_Settings_Config=0,
    General_Settings_Config_Down=0,
    General_Settings_Config_Up=0,
    General_Settings_Config_Value=0,
    General_Settings_Join_Co_planar_sheets=False)
mitered_joint = MiteredJoint(
    Gap=0,
    General_Settings=True,
    General_Settings_Config=0,
    General_Settings_Config_Down=0,
    General_Settings_Config_Up=0,
    General_Settings_Config_Value=0,
    General_Settings_Join_Co_planar_sheets=False)
assemble_2 = Assemble(PlanarPolysurface=breps_to_pps_2, ShellType=negative_shell_default_2, JointType=blind_finger_joint)
disassemble_2 = Disassemble(Assembly=assemble_2)  # -> Part, Joint, Node
shell_geometry_2 = ShellGeometry(Part=disassemble_2.Part)  # -> ShellIndex, ConvexEdges, ConvexFaces, Solid, TopPlane, RawPart

# ---- group: Creating groove
rectangle_2 = Rectangle(Plane=PlaneXY(0, 0, 0), XSize=Slider(4.6, range=0..10), YSize=Slider(4.8, range=0..10), Radius=0)  # -> Rectangle, Length
unit_z_3 = UnitZ(Factor=Slider(0.55, range=0..1))
extrude_3 = Extrude(Base=rectangle_2.Rectangle, Direction=unit_z_3)
brep_4 = Brep(extrude_3)
cap_holes_2 = CapHoles(Brep=brep_4)
unit_z_4 = UnitZ(Factor=Slider(4.25, range=0..10))
brep_5 = Brep(cap_holes_2)
move = Move(Geometry=brep_5, Motion=unit_z_4)  # -> Geometry, Transform

# ----
scale_lid_make_groove = GhPythonScript(brep=lid_before_scale)  # -> out, lid, groove
# ---------- scale_lid_make_groove: Python ----------
__author__ = "short"
__version__ = "2023.12.05"

import rhinoscriptsyntax as rs
import Rhino.Geometry as rg

brep = rs.coercebrep(brep)

def scale_brep(brep, scale_lid_x, scale_lid_y, scale_lid_z, plane):
   
    # Create a non-uniform scale transformation
    transform = rg.Transform.Scale(plane, scale_lid_x, scale_lid_y, scale_lid_z)
    
    # Duplicate the brep to avoid altering the original geometry
    scaled_brep = brep.DuplicateBrep()
    
    # Apply the scale transformation to the duplicated BRep
    scaled_brep.Transform(transform)
    
    return scaled_brep

# Define your inputs here
input_brep = brep 
scale_lid_x = 0.85 
scale_lid_y = 0.95 
scale_lid_z = 1.0 
scale_groove_x = 1.06 
scale_groove_y = 1.06 
scale_groove_z = 1.5
plane = rg.Plane.WorldXY 

# Call the function to scale the BRep
scaled_lid = scale_brep(input_brep, scale_lid_x, scale_lid_y, scale_lid_z, plane)

groove = scale_brep(scaled_lid, scale_groove_x, scale_groove_y, scale_groove_z, plane)

# Output the scaled BRep
lid = scaled_lid
# ---------- end scale_lid_make_groove ----------

# ---- group: Scale Lid
scale_nu = ScaleNU(Plane=PlaneXY(0, 0, 0), ScaleX=Slider(0.9, range=0..1), ScaleY=Slider(0.95, range=0..1), ScaleZ=1)  # -> Geometry, Transform

# ----
lid = Brep(scale_lid_make_groove.lid)
groove = Brep(scale_lid_make_groove.groove)
sides = Brep(shell_geometry_2.Solid)
unit_x = UnitX(Factor=Slider(0.25, range=0..1))
move_2 = Move(Geometry=groove, Motion=unit_x)  # -> Geometry, Transform
subtraction = Subtraction(A=Slider(0, range=0..100), B=Slider(2.75, range=0..10))
groove_2 = Brep(move_2.Geometry)
unit_z_5 = UnitZ(Factor=subtraction)
move_3 = Move(Geometry=groove_2, Motion=unit_z_5)  # -> Geometry, Transform
solid_difference = SolidDifference(BrepsA=sides, BrepsB=move_3.Geometry)
container = Brep(solid_difference)
