# Grasshopper definition TaskOne.gh (Grasshopper 1.0.7)

number_slider = Slider(105, range=0..1000)
number_slider_2 = Slider(0.3, range=0..1)
unit_z = UnitZ(Factor=Slider(3, range=0..10))
construct_point = ConstructPoint(XCoordinate=number_slider, YCoordinate=number_slider, ZCoordinate=0)
circle = Circle(Plane=PlaneXY(0, 0, 0), Radius=Slider(10, range=0..10))
extrude = Extrude(Base=circle, Direction=unit_z)
vector_2pt = Vector2Pt(PointA=construct_point, PointB=construct_point, Unitize=False)  # -> Vector, Length
cap_holes = CapHoles(Brep=extrude)
move = Move(Geometry=cap_holes, Motion=vector_2pt.Vector)  # -> Geometry, Transform
unit_z_2 = UnitZ(Factor=1)
brep = Brep(move.Geometry)
vector = Vector(unit_z_2)
contour = Contour(Shape=brep, Point=Point(0, 0, 0), Direction=vector, Distance=Slider(0.3, range=0..1))
boundary_surfaces = BoundarySurfaces(Edges=contour)
bounding_box = BoundingBox(Content=boundary_surfaces, Plane=PlaneXY(0, 0, 0))  # -> Box, Box_2
unit_x = UnitX(Factor=Slider(0.3, range=0..1))
linear_array = LinearArray(Geometry=bounding_box.Box, Direction=unit_x, Count=Slider(75, range=0..100))  # -> Geometry, Transform
brep_brep = BrepBrep(BrepA=linear_array.Geometry, BrepB=contour)  # -> Curves, Points
trim_tree = TrimTree(Tree=brep_brep.Curves, Depth=1)
merge = Merge(Data1=contour, Data2=trim_tree)
divide_length = DivideLength(Curve=merge, Length=Slider(0.1, range=0..0.1))  # -> Points, Tangents, Parameters
shift_list = ShiftList(List=divide_length.Points, Shift=Slider(1, range=0..1), Wrap=True)
line = Line(StartPoint=divide_length.Points, EndPoint=shift_list)
