# Grasshopper definition sphere.gh (Grasshopper 1.0.7)

unit_z = UnitZ(Factor=1)
point = Point(<point referenced from the Rhino model>)
xy_plane = XYPlane(Origin=point)
sphere = Sphere(Base=point, Radius=Slider(3, range=0..100))
brep = Brep(sphere)
bounding_box = BoundingBox(Content=brep, Plane=xy_plane)  # -> Box, Box_2
deconstruct_brep = DeconstructBrep(Brep=bounding_box.Box)  # -> Faces, Edges, Vertices
list_item = ListItem(List=deconstruct_brep.Vertices, Index=0, Wrap=True)
deconstruct = Deconstruct(Point=list_item)  # -> XComponent, YComponent, ZComponent
panel = Panel(list_item)
panel_2 = Panel(brep)
bounds = Bounds(Numbers=deconstruct.ZComponent)
series = Series(Start=bounds, Step=Slider(0.12, range=0..1), Count=Slider(20, range=0..100))
amplitude = Amplitude(Vector=unit_z, Amplitude=series)
move = Move(Geometry=xy_plane, Motion=amplitude)  # -> Geometry, Transform
brep_brep = BrepBrep(BrepA=move.Geometry, BrepB=brep)  # -> Curves, Points
area = Area(Geometry=brep_brep.Curves)  # -> Area, Centroid
param_viewer = ParamViewer(brep_brep.Curves)
