# Grasshopper definition vase.gh (Grasshopper 1.0.7)

unit_z = UnitZ(Factor=1)
construct_point = ConstructPoint(XCoordinate=Slider(10, range=0..10), YCoordinate=Slider(10, range=0..10), ZCoordinate=Slider(12, range=0..100))
point = Point(<point referenced from the Rhino model>)
point_2 = Point(<point referenced from the Rhino model>)
xy_plane = XYPlane(Origin=point)
box_2pt = Box2Pt(PointA=point_2, PointB=construct_point, Plane=xy_plane)
multiplication = Multiplication(A=unit_z, B=Slider(20, range=0..100))
polygon = Polygon(Plane=xy_plane, Radius=Slider(8, range=0..10), Segments=Slider(5, range=0..10), FilletRadius=Slider(1, range=0..1))  # -> Polygon, Length
extrude = Extrude(Base=polygon.Polygon, Direction=multiplication)
radians = Radians(Degrees=Slider(112, range=0..1000))
panel = Panel(radians)
unit_z_2 = UnitZ(Factor=1)
offset_curve = OffsetCurve(Curve=polygon.Polygon, Distance=Slider(-3, range=-5..10), Plane=xy_plane, Corners=1)
multiplication_2 = Multiplication(A=unit_z_2, B=Slider(11, range=0..100))
extrude_2 = Extrude(Base=offset_curve, Direction=multiplication_2)
unit_z_3 = UnitZ(Factor=1)
point_3 = Point(<point referenced from the Rhino model>)
multiplication_3 = Multiplication(A=unit_z_3, B=Slider(44, range=0..100))
move = Move(Geometry=point_3, Motion=multiplication_3)  # -> Geometry, Transform
line = Line(StartPoint=point_3, EndPoint=move.Geometry)
twist = Twist(Geometry=extrude, Axis=line, Angle=radians, Infinite="True", Rigid=False)
twist_2 = Twist(Geometry=extrude_2, Axis=line, Angle=radians, Infinite="True", Rigid=False)
deconstruct_brep = DeconstructBrep(Brep=twist)  # -> Faces, Edges, Vertices
solid_difference = SolidDifference(BrepsA=twist, BrepsB=twist_2)
deconstruct_brep_2 = DeconstructBrep(Brep=twist_2)  # -> Faces, Edges, Vertices
list_item = ListItem(List=deconstruct_brep.Edges, Index=0, Wrap=True)
list_item_2 = ListItem(List=deconstruct_brep_2.Edges, Index=0, Wrap=True)
merge = Merge(Data1=list_item_2, Data2=list_item)
loft = Loft(Curves=merge, Options={Adjust=False, Closed=False, LoftEnds=0, LoftSimp=0, LoftType=0, Rebuild=10, Refit=0.01})
